# Grasshopper definition BAL_demoFile.gh (Grasshopper 1.0.7)
# plug-ins: BeingAliveLanguage

number_slider = Slider(0.28, range=0..1)
number_slider_2 = Slider(0.38, range=0..1)
expression = Expression(x=number_slider_2, y=number_slider, Expression="1-x-y")

# ----
# Resolution
crv = Curve(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)
balsoilbase = SoilBase(Boundary=crv, Resolution=Slider(9, range=1..10))  # -> TriGrid, UnitLength
crv_2 = Curve(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)  # disabled
soilcontent = BALSoilContent(
    SoilBase=flatten(balsoilbase.TriGrid),
    SandRatio=number_slider_2,
    SiltRatio=number_slider,
    ClayRatio=expression,
    Rocks=flatten(crv_2))  # -> SoilInfo, SandTri, SiltTri, ClayTri, AllTri

soilog_in = BALSoilInteriorOrganicMatter(SoilInfo=soilcontent.SoilInfo, Boundary=crv, SoilTri=soilcontent.AllTri, OrganicMatterDensity=0.5)  # -> OrganicMatter, OrganicMatterProperty
soilog_top = BALSoilSurfaceOrganicMatter(Boundary=crv, OMUnitSize=1, NumLayer=Slider(4, range=0..10), UnitLength=balsoilbase.UnitLength, OrganicMatterDensity=0.9)
soilog_topdepend = BALSoilSurfaceOrganicMatterDependentVersion(OMProperty=soilog_in.OrganicMatterProperty, OMUnitSize=1, NumLayer=Slider(1, range=0..10))

soilwatervis = BALSoilWaterVisualization(
    SoilInfo=soilcontent.SoilInfo,
    SoilTri=soilcontent.AllTri,
    CurrentWaterRatio=0.5,
    CoreWaterHatchDensity=3,
    AvailableWaterHatchDensity=5)  # -> SoilCore, WiltingPoint, FieldCapacity, CurrentWaterLine, EmbeddedWaterHatch, CurrentWaterHatch

soilinfotext = BALSoilInformation(SoilInfo=soilcontent.SoilInfo)
pt = Point(Point(52.07858803, 11.16096038, 0))
panel = Panel(soilinfotext)
tag = TextTag(Location=pt, Text=soilinfotext)
